# Grasshopper definition 1_oscillator.gh (Grasshopper 1.0.7)
# plug-ins: Siren

crv = Curve([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])
nickname = CVFromGeometryComponent(Curve=crv, SampleRate="200")  # -> Wave, Trigger
number_slider = Slider(0.1, range=0..0.1)
nickname_2 = CVQuantizer(Wave=nickname.Wave, scaleName="Major Pentatonic")  # -> Wave, Trigger
osc = CVOscillator(Frequency=nickname_2.Wave, wavetype="Sawtooth")
osc_2 = CVOscillator(Frequency=nickname_2.Wave, Tuning=number_slider, wavetype="Sawtooth")
osc_3 = CVOscillator(Frequency=nickname_2.Wave, Octave=Slider(-1, range=-1..2), Tuning=number_slider, wavetype="Sawtooth")
mixer = Mixer(W1=osc, W2=osc_2, W3=osc_3)
crv_2 = Curve([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])
nickname_3 = CVFromGeometryComponent(Curve=crv_2, SampleRate="200")  # -> Wave, Trigger
nickname_4 = VCAComponent(Wave=mixer, Amplitude=nickname_3.Wave)
nickname_5 = AudioOutComponent(Wave=nickname_4)  # -> PlayProgress, Level
nickname_6 = SampleToCurveComponent(Wave=nickname_4, Resolution="1000", PlayProgress=nickname_5.PlayProgress)  # -> Polyline, Playhead
